# Grasshopper definition floating_boxes.gh (Grasshopper 1.0.7)

number_slider = Slider(25, range=0..100)
number_slider_2 = Slider(20, range=0..100)
construct_point = ConstructPoint(XCoordinate=0, YCoordinate=0, ZCoordinate=0)
rectangular = Rectangular(Plane=construct_point, SizeX=number_slider_2, SizeY=number_slider_2, ExtentX=number_slider, ExtentY=number_slider)  # -> Cells, Points
cull_duplicates = CullDuplicates(Points=rectangular.Points, Tolerance=0.1, CullMode=3)  # -> flatten(Points), Indices, Valence

# ---- group: RH_IN:height
number_slider_3 = Slider(292, range=0..400)

# ----
list_length = ListLength(List=cull_duplicates.Points)
construct_domain = ConstructDomain(DomainStart=Slider(0, range=0..100), DomainEnd=number_slider_3)
random = Random(Range=construct_domain, Number=list_length, Seed=Slider(10, range=-1..10))
unit_z = UnitZ(Factor=random)
move = Move(Geometry=cull_duplicates.Points, Motion=unit_z)  # -> Geometry, Transform

# ---- group: RH_IN:size
number_slider_4 = Slider(9, range=1..10)

# ----
construct_domain_2 = ConstructDomain(DomainStart=Slider(1, range=1..100), DomainEnd=number_slider_4)
number_slider_5 = Slider(3, range=0..10)
random_2 = Random(Range=construct_domain_2, Number=list_length, Seed=Slider(4, range=0..10))
center_box = CenterBox(Base=move.Geometry, X=number_slider_5, Y=number_slider_5, Z=number_slider_5)
scale = Scale(Geometry=center_box, Center=move.Geometry, Factor=random_2)  # -> Geometry, Transform
geometry = Geometry(scale.Geometry)
mesh_brep = MeshBrep(
    Brep=geometry,
    Settings={GridMaxCount=0, GridMinCount=16, JaggedSeams=False, MaxEdgeLength=0, MinEdgeLength=0.0001, MinTolerance=0, Refine=True, RefineAngle=0, RelativeTolerance=0.65, SimplePlanes=True, Tolerance=0})

# ---- group: RH_OUT:mesh
mesh = Mesh(mesh_brep)
